# Grasshopper definition 20171213_Connectivity.gh (Grasshopper 0.9.76)
# plug-ins: atit, Human, horsterCameraControl, gHowl, LunchBox, TT Toolbox

# ----
# KPFui GH Standards
# Notes: Panels can (but do not have to) be 50% saturation to avoid overwhelming in text
# Results
data = Data(True)  # disabled
# GLOBALS
# These are top level settings for the entire defintion.
# Everything with wireless connections should be in this area.
# MAIN
# Create main functionality of definition.
result_panel = Panel("")  # disabled

crv_broadway = Curve(<curve referenced from the Rhino model>)

# ----
# Viz
viz_panel = Panel("")  # disabled
data_2 = Data(True)  # disabled

number_slider = Slider(800, range=0..800)
number_slider_2 = Slider(0, range=0..800)
path = FilePath("U:\XIM_Udrive\KPFurban_book\Reference\Turnstiles_Geocoded.xlsx")

# ----
# Action
action_panel = Panel("")  # disabled
button = Button()  # disabled

panel = Panel(path)
end = EndPoints(Curve=crv_broadway)  # -> Start, End
lens = Slider(5.5, range=0..10)
divide = DivideCurve(Curve=crv_broadway, Count=number_slider, Kinks=False)  # -> Points, Tangents, Parameters
ln = Line(StartPoint=end.Start, EndPoint=end.End)

# ----
# Inputs
inputs_panel = Panel("")  # disabled
data_3 = Data(True)  # disabled

item = ListItem(List=divide.Points, Index=number_slider_2, Wrap=True)
divide_2 = DivideCurve(Curve=ln, Count=number_slider, Kinks=False)  # -> Points, Tangents, Parameters
data_up = Data(Vector(0.4809887689, 0.8767267557, 0))
division = Division(A=lens, B="1000000")
panel_2 = Panel(data_up)
item_2 = ListItem(List=divide_2.Points, Index=number_slider_2, Wrap=True)

# ----
# Intermediate
intermediate_panel = Panel("")  # disabled
data_4 = Data(True)  # disabled

# ---- group: Geolocated Subway Stops
excelread = ExcelReader(ReadExcelData=Toggle(True), WorkbookPath=panel, WorksheetName="1")  # -> Exceptions, ExcelData

# ----
pt_grand_central = Point(<point referenced from the Rhino model>)
pt_queensboro = Point(<point referenced from the Rhino model>)
pt_sunnyside = Point(<point referenced from the Rhino model>)
pt_redhook = Point(<point referenced from the Rhino model>)
pt_brooklyn = Point(<point referenced from the Rhino model>)
pt_penn = Point(<point referenced from the Rhino model>)
pt_125st = Point(<point referenced from the Rhino model>)
pt_pabt = Point(<point referenced from the Rhino model>)

# ----
# DO NOT TOUCH
sacred_data_panel = Panel("")  # disabled
data_5 = Data(True)  # disabled

station_name = Panel("2")
train_line = Panel("3")
latitude = Panel("5")
longitude = Panel("6")
pt = Point(item)
setcam = SetCamera(CameraLocation=item_2, TargetLocation=item_2, LensLength=division, UpDirection=data_up, Activate=Toggle(True))
pt_2 = Point(pt_pabt)
path_2 = FilePath("U:\XIM_Udrive\KPFurban_book\Reference\SUBWAY\Subway_Lines_March_2017_NAD1983.shp")
branch = TreeBranch(Tree=excelread.ExcelData, Path=latitude, MaintainPaths=True)
branch_2 = TreeBranch(Tree=excelread.ExcelData, Path=longitude, MaintainPaths=True)
branch_3 = TreeBranch(Tree=excelread.ExcelData, Path=station_name, MaintainPaths=True)
branch_4 = TreeBranch(Tree=excelread.ExcelData, Path=train_line, MaintainPaths=True)

# ---- group: Lat/Long Reference
p2_lon = Panel("-73.998580")
p2_lat = Panel("40.745485")
p1_lon = Panel("-73.981141")
p1_lat = Panel("40.753429")
pt_3 = ConstructPoint(XCoordinate=p1_lon, YCoordinate=p1_lat, ZCoordinate=0)
pt_4 = ConstructPoint(XCoordinate=p2_lon, YCoordinate=p2_lat, ZCoordinate=0)
pt_2_2 = Point(pt_3)
pt_1 = Point(pt_4)

# ----
data_train_line = Data(branch_4)
chars = Characters(Text=branch_2)  # -> Result, Unicode
data_station_name = Data(flatten(branch_3))
panel_3 = Panel(path_2)
chars_2 = Characters(Text=branch)  # -> Result, Unicode
walking_distance = Panel("2730")
pt_center = Point(pt_2)

walking_distance_2 = Panel("1320")
walking_distance_3 = Panel("1000")

join = TextJoin(Text=chars_2.Result)  # -> flatten(Result)
join_2 = TextJoin(Text=chars.Result)  # -> flatten(Result)

# ---- group: Lat/Long Reference / P1 XYZ
pt_5 = Point(<point referenced from the Rhino model>)

# ---- group: Lat/Long Reference / P2 XYZ
pt_6 = Point(<point referenced from the Rhino model>)

# ----
num = Number(join)
num_2 = Number(join_2)
data_station_name_2 = Data(data_station_name)

# ---- group: Long
nullrep = ReplaceNulls(Items=num_2, Replacements="0")  # -> Items, Count

# ---- group: Lat
nullrep_2 = ReplaceNulls(Items=num, Replacements="0")  # -> Items, Count

# ---- group: Train Radius
circle = CircleCNR(Center=pt_center, Normal=Vector(0, 0, 1), Radius=walking_distance_3)

# ---- group: Walking Radius
circle_2 = CircleCNR(Center=pt_center, Normal=Vector(0, 0, 1), Radius=walking_distance)

# ----
toggle = BooleanToggle(True)
crv_walking_radius = Curve(circle_2)
imp_it = ImpIt(ShapefileShpPath=panel_3, Project2WGS84=False, TrueOrFalse=toggle)  # -> Shapes, Features
circle_3 = CircleCNR(Center=pt_center, Normal=Vector(0, 0, 1), Radius=Slider(100, range=0..100))
pt_7 = ConstructPoint(XCoordinate=nullrep.Items, YCoordinate=nullrep_2.Items, ZCoordinate=0)
pt_center_2 = Point(pt_center)

# ---- group: Subway Lines
datavis_it = DataVisIt(Shapes=imp_it.Shapes, GetValueofFeature="name", TrueOrFalse=toggle)  # -> Polygon, Polyline, flatten(Point), AttValues

# ---- group: Convert Subway Lat/Long to Pts in Rhino Space
geo_xyz = GeoToXYZ(Geo_IN=simplify(graft(pt_7)), Pt1ReferenceXYZ=pt_5, Pt2ReferenceXYZ=pt_6, Pt1ReferenceGeo=pt_1, Pt2ReferenceGeo=pt_2_2)  # -> simplify(flatten(XYZPoints))

# ----
previewlw = CustomPreviewLineweights(Geometry=circle_3, Shader=ColourSwatch(SwatchColor=RGB(161, 0, 0)), Thickness=Slider(3, range=0..10), Absolute=False)
data_train_line_2 = Data(flatten(data_train_line))
pt_subway_stops = Point(geo_xyz)
ccx = CurveCurve(CurveA=circle, CurveB=datavis_it.Polyline)  # -> Points, ParamsA, ParamsB
null = NullItem(Item=ccx.Points)  # -> NullFlags, InvalidFlags, Description
dispatch = Dispatch(List=datavis_it.AttValues, DispatchPattern=null.NullFlags)  # -> ListA, ListB
clean = CleanTree(RemoveNulls=True, RemoveInvalid=True, RemoveEmpty=True, Tree=dispatch.ListB)  # -> flatten(Tree)
data_train_line_3 = Data(data_train_line_2)
split = TextSplit(Text=clean, Separators="-")  # -> flatten(Result)
data_train_line_4 = Data(data_train_line_2)
chars_3 = Characters(Text=data_train_line_3)  # -> Result, Unicode
cset = CreateSet(List=split)  # -> Set, Map

# ---- group: Trains w/in 5 radius
data_train_line_5 = Data(cset.Set)

# ----
crv_subway_lines = Curve(datavis_it.Polyline)
intersection = SetIntersection(SetA=data_train_line_5, SetB=chars_3.Result)
split_2 = TextSplit(Text=datavis_it.AttValues, Separators="-")
null_2 = NullItem(Item=intersection)  # -> NullFlags, InvalidFlags, Description
pt_center_3 = Point(pt_center_2)
tsort = SortText(Keys=null_2.NullFlags, Culture=127)  # -> Keys, Values
panel_4 = Panel("False")
intersection_2 = SetIntersection(SetA=split_2, SetB=data_train_line_5)
pt_subway_stops_2 = Point(pt_subway_stops)
item_3 = ListItem(List=tsort.Keys, Index=0, Wrap=True)  # -> flatten(Item)
data_station_name_3 = Data(data_station_name_2)
null_3 = NullItem(Item=intersection_2)  # -> NullFlags, InvalidFlags, Description
dispatch_2 = Dispatch(List=pt_subway_stops_2, DispatchPattern=item_3)  # -> ListA, ListB
dispatch_3 = Dispatch(List=crv_subway_lines, DispatchPattern=null_3.NullFlags)  # -> ListA, ListB
dispatch_4 = Dispatch(List=data_train_line_4, DispatchPattern=item_3)  # -> ListA, ListB
dispatch_5 = Dispatch(List=data_station_name_3, DispatchPattern=item_3)  # -> ListA, ListB
dispatch_6 = Dispatch(List=split_2, DispatchPattern=null_3.NullFlags)  # -> ListA, ListB
clean_2 = CleanTree(RemoveNulls=True, RemoveInvalid=True, RemoveEmpty=True, Tree=dispatch_3.ListB)
data_station_name_4 = Data(dispatch_5.ListB)

# ---- group: On Lines That Intersect w/ Radius
pt_subway_stops_3 = Point(dispatch_2.ListB)

# ----
clean_3 = CleanTree(RemoveNulls=True, RemoveInvalid=True, RemoveEmpty=True, Tree=dispatch_6.ListB)
pt_center_4 = Point(pt_center_3)
data_train_line_6 = Data(dispatch_4.ListB)
item_4 = ListItem(List=clean_3, Index=0, Wrap=True)
max_travel_dist_w_in_time_permitted = Panel("9100")

# ---- group: That Intersect w/ Radius
crv_subway_lines_2 = Curve(clean_2)

# ----
panel_5 = Panel(data_train_line_6)
cluster_colors = ClusterColors(M=item_4)  # -> I, i
dist = Distance(PointA=pt_center_4, PointB=pt_subway_stops_3)
smaller = SmallerThan(FirstNumber=dist, SecondNumber=max_travel_dist_w_in_time_permitted)  # -> SmallerThan, OrEqualTo
crv_walking_radius_2 = Curve(crv_walking_radius)
dispatch_7 = Dispatch(List=data_station_name_4, DispatchPattern=smaller.SmallerThan)  # -> ListA, ListB
dispatch_8 = Dispatch(List=pt_subway_stops_3, DispatchPattern=smaller.SmallerThan)  # -> ListA, ListB
data_station_name_5 = Data(dispatch_7.ListA)
previewlw_2 = CustomPreviewLineweights(Geometry=crv_subway_lines_2, Shader=cluster_colors.i, Thickness=Slider(1, range=0..10), Absolute=False)
pt_subway_stops_4 = Point(dispatch_8.ListA)
ft_min_subway = Panel("1496")
dist_2 = Distance(PointA=pt_center_4, PointB=pt_subway_stops_4)
int = Integer(dist_2)
wait_time = Panel("3")
division_2 = Division(A=int, B=ft_min_subway)
addition = Addition(A=wait_time, B=division_2)
num_minutesfromcenter = Number(addition)
total_time = Panel("10")
subtraction = Subtraction(A=total_time, B=num_minutesfromcenter)
path_staten_island = FilePath("Q:\Projects\2085_XIM\00Data\01 GIS\New York City\01 GIS data\PLUTO\MapPLUTO 16V2\si_mappluto_16v2\SIMapPLUTO.shp")
path_queens = FilePath("Q:\Projects\2085_XIM\00Data\01 GIS\New York City\01 GIS data\PLUTO\MapPLUTO 16V2\qn_mappluto_16v2\QNMapPLUTO.shp")
num_timeremaining = Number(subtraction)
path_manhattan = FilePath("U:\XIM_Udrive\KPFurban_book\Reference\PLUTO\MNMapPLUTO.shp")
path_brooklyn = FilePath("Q:\Projects\2085_XIM\00Data\01 GIS\New York City\01 GIS data\PLUTO\MapPLUTO 16V2\bk_mappluto_16v2\BKMapPLUTO.shp")
ft_min_walking = Panel("273")
path_bronx = FilePath("Q:\Projects\2085_XIM\00Data\01 GIS\New York City\01 GIS data\PLUTO\MapPLUTO 16V2\bx_mappluto_16v2\BXMapPLUTO.shp")
crv_walking_radius_3 = Curve(crv_walking_radius_2)
data_6 = Data(path_manhattan)
pt_subway_stops_5 = Point(pt_subway_stops_4)
multiplication = Multiplication(A=ft_min_walking, B=num_timeremaining)
data_7 = Data(path_queens)
feat_it = FeatIt(ShapefileShpPath=data_6)  # -> GeometryType, ProjectionType, Features
panel_6 = Panel(data_6)
panel_7 = Panel(data_7)
feat_it_2 = FeatIt(ShapefileShpPath=data_7)  # -> GeometryType, ProjectionType, Features
panel_8 = Panel(feat_it.ProjectionType)

# ---- group: Subway_Radii
circle_4 = CircleCNR(Center=pt_subway_stops_5, Normal=Vector(0, 0, 1), Radius=multiplication)

# ----
toggle_2 = BooleanToggle(True)
panel_9 = Panel(feat_it_2.ProjectionType)
toggle_3 = BooleanToggle(True)
pt_subway_stops_6 = Point(pt_subway_stops_5)
imp_it_2 = ImpIt(ShapefileShpPath=panel_6, Project2WGS84=False, TrueOrFalse=toggle_2)  # -> Shapes, Features
imp_it_3 = ImpIt(ShapefileShpPath=panel_7, Project2WGS84=False, TrueOrFalse=toggle_3)  # -> Shapes, Features
panel_10 = Panel("BldgArea")
panel_11 = Panel(imp_it_2.Features)
crv_walking_radius_4 = Curve(crv_walking_radius_3)
crv_subway_radii = Curve(circle_4)
pt_center_5 = Point(pt_center_3)
datavis_it_2 = DataVisIt(Shapes=imp_it_2.Shapes, GetValueofFeature="BldgArea", TrueOrFalse=toggle_2)  # -> Polygon, Polyline, Point, flatten(AttValues)
pt_subway_stops_7 = Point(pt_subway_stops_6)
datavis_it_3 = DataVisIt(Shapes=imp_it_3.Shapes, GetValueofFeature="BldgArea", TrueOrFalse=toggle_3)  # -> Polygon, Polyline, Point, flatten(AttValues)
panel_12 = Panel(datavis_it_2.Polygon)
area = Area(Geometry=datavis_it_2.Polygon)  # -> Area, Centroid
cullduppoints = RemoveDuplicatePoints(InputPoints=pt_subway_stops_7, Tolerance=0.001)  # -> OutputPoints, FirstPointIndexes
data_values = Data(datavis_it_2.AttValues)
area_2 = Area(Geometry=datavis_it_3.Polygon)  # -> Area, Centroid
merge = Merge(Data1=crv_walking_radius_4, Data2=crv_subway_radii)  # -> flatten(Result)
sort = SortList(Keys=area.Area, ValuesA=datavis_it_2.Polygon)  # -> reverse(Keys), reverse(ValuesA)
null_4 = NullItem(Item=cullduppoints.OutputPoints)  # -> NullFlags, InvalidFlags, Description
data_values_2 = Data(datavis_it_3.AttValues)
sort_2 = SortList(Keys=area_2.Area, ValuesA=datavis_it_3.Polygon)  # -> reverse(Keys), reverse(ValuesA)
panel_13 = Panel(imp_it_3.Features)
area_3 = Area(Geometry=merge)  # -> Area, simplify(graft(Centroid))

# ---- group: Isolate 1 Primary Crv for Each Lot
item_5 = ListItem(List=sort.ValuesA, Index=0, Wrap=True)  # -> flatten(Item)

item_6 = ListItem(List=sort_2.ValuesA, Index=0, Wrap=True)  # -> flatten(Item)

# ----
dispatch_9 = Dispatch(List=pt_subway_stops_7, DispatchPattern=null_4.NullFlags)  # -> ListA, ListB
pt_subway_stops_8 = Point(dispatch_9.ListB)
ft_min_subway_2 = Panel("1496")

# ---- group: Walking Borough
merge_2 = Merge(Data1=crv_walking_radius_4, Data2=crv_subway_radii)  # -> flatten(Result)

# ----
dist_3 = Distance(PointA=pt_center_5, PointB=area_3.Centroid)
getcamera = GetCamera(GetCamera=Toggle(True))  # -> Location, Target, LensLength, UpDirection
dist_4 = Distance(PointA=pt_subway_stops_8, PointB=getcamera.Location)
int_2 = Integer(dist_3)
area_4 = Area(Geometry=item_5)  # -> Area, Centroid
merge_3 = Merge(Data1=crv_subway_radii)
data_station_name_6 = Data(data_station_name_5)
area_5 = Area(Geometry=item_6)  # -> Area, Centroid

height = Slider(1404, range=0..3500)

division_3 = Division(A=int_2, B=ft_min_subway_2)
crv = Curve(<curve referenced from the Rhino model>)
pt_subway_stops_9 = Point(dispatch_9.ListB)
incurves = PointInCurves(Point=area_4.Centroid, Curves=merge_2)  # -> Relationship, Index, Point
lng = ListLength(List=dist_4)
sort_3 = SortList(Keys=dist_4, ValuesA=pt_subway_stops_8)  # -> Keys, ValuesA
incurves_2 = PointInCurves(Point=area_5.Centroid, Curves=merge_3)  # -> Relationship, Index, Point
num_minutesfromcenter_2 = Number(division_3)
dist_5 = Distance(PointA=pt_subway_stops_9, PointB=getcamera.Location)
dispatch_10 = Dispatch(List=data_station_name_6, DispatchPattern=null_4.NullFlags)  # -> ListA, ListB
neg = Negative(Value=Slider(35, range=0..100))
dispatch_11 = Dispatch(List=item_5, DispatchPattern=incurves.Relationship)  # -> ListA, ListB
dispatch_12 = Dispatch(List=data_values, DispatchPattern=incurves.Relationship)  # -> ListA, ListB
dispatch_13 = Dispatch(List=area_4.Centroid, DispatchPattern=incurves.Relationship)  # -> ListA, ListB
series = Series(Start=height, Step=Slider(98, range=0..1000), Count=lng)
dispatch_14 = Dispatch(List=item_6, DispatchPattern=incurves_2.Relationship)  # -> ListA, ListB
dispatch_15 = Dispatch(List=data_values_2, DispatchPattern=incurves_2.Relationship)  # -> ListA, ListB
dispatch_16 = Dispatch(List=area_5.Centroid, DispatchPattern=incurves_2.Relationship)  # -> ListA, ListB

height_2 = Slider(2092, range=0..3500)

sort_4 = SortList(Keys=dist_5, ValuesA=dispatch_10.ListB)  # -> Keys, ValuesA
lng_2 = ListLength(List=dist_5)

# ---- group: In Radius
crv_bldg_footprints = Curve(dispatch_11.ListA)
pt_bldg_centers = Point(dispatch_13.ListA)
data_values_3 = Data(dispatch_12.ListA)

# ----
sort_5 = SortList(Keys=dist_5, ValuesA=pt_subway_stops_9)  # -> Keys, ValuesA
larger = LargerThan(FirstNumber=num_minutesfromcenter_2, SecondNumber="0")  # -> LargerThan, OrEqualTo
end_2 = EndPoints(Curve=crv)  # -> Start, End
rotate = Rotate(Geometry=crv, Angle=degrees(neg), Plane=end_2.Start)  # -> Geometry, Transform
end_3 = EndPoints(Curve=rotate.Geometry)  # -> Start, End

# ---- group: In Radius
crv_bldg_footprints_2 = Curve(dispatch_14.ListA)
pt_bldg_centers_2 = Point(dispatch_16.ListA)
data_values_4 = Data(dispatch_15.ListA)

# ----
panel_14 = Panel(sort_4.ValuesA)
series_2 = Series(Start=height_2, Step=Slider(110, range=0..1000), Count=lng_2)
dispatch_17 = Dispatch(List=num_minutesfromcenter_2, DispatchPattern=larger.LargerThan)  # -> ListA, ListB
vec2pt = Vector2Pt(PointA=end_3.Start, PointB=end_3.End, Unitize=False)  # -> Vector, Length
pt_8 = Point(end_2.Start)
pt_subway_stops_10 = Point(sort_3.ValuesA)
vec2pt_2 = Vector2Pt(PointA=end_2.Start, PointB=end_2.End, Unitize=False)  # -> Vector, Length
wait_time_2 = Panel("3")
amp = Amplitude(Vector=vec2pt_2.Vector, Amplitude=series)
clean_4 = CleanTree(RemoveNulls=True, RemoveInvalid=True, RemoveEmpty=True, Tree=dispatch_17.ListA)
cls = Closed(Curve=crv_bldg_footprints)  # -> Closed, Periodic
amp_2 = Amplitude(Vector=vec2pt.Vector, Amplitude=Slider(1215, range=0..3100))
Z = UnitZ(Factor=series_2)
cls_2 = Closed(Curve=crv_bldg_footprints_2)  # -> Closed, Periodic
merge_4 = Merge(Data1=data_values_4, Data2=data_values_3)  # -> flatten(Result)
dispatch_18 = Dispatch(List=crv_bldg_footprints, DispatchPattern=cls.Closed)  # -> ListA, ListB
addition_2 = Addition(A=wait_time_2, B=clean_4)
move = Move(Geometry=pt_8, Motion=amp_2)  # -> Geometry, Transform
move_2 = Move(Geometry=sort_5.ValuesA, Motion=Z)  # -> Geometry, Transform
dispatch_19 = Dispatch(List=crv_bldg_footprints_2, DispatchPattern=cls_2.Closed)  # -> ListA, ListB
move_3 = Move(Geometry=pt_subway_stops_10, Motion=amp)  # -> Geometry, Transform
ma = MassAddition(Input=merge_4)  # -> Result, PartialResults
ln_2 = Line(StartPoint=pt_8, EndPoint=move.Geometry)
pt_9 = Point(move_2.Geometry)
ft_min_walking_2 = Panel("273")
merge_5 = Merge(Data1=addition_2, Data2=dispatch_17.ListB)
pt_10 = Point(move_3.Geometry)
Z_2 = UnitZ(Factor=Slider(71, range=0..1100))
format = Format(int_adds_thousands_separator=ma.Result)
pt_subway_stops_11 = Point(pt_subway_stops_10)
orient = Orient(Geometry=ln_2, Source=pt_8, Target=pt_subway_stops_10)  # -> Geometry, Transform
move_4 = Move(Geometry=pt_9, Motion=Z_2)  # -> Geometry, Transform
ln_3 = Line(StartPoint=sort_5.ValuesA, EndPoint=pt_9)
ln_4 = Line(StartPoint=pt_subway_stops_10, EndPoint=pt_10)
multiplication_2 = Multiplication(A=ft_min_walking_2, B=merge_5)
end_4 = EndPoints(Curve=orient.Geometry)  # -> Start, End
accessible_gfa = Panel(format)
vec2pt_3 = Vector2Pt(PointA=getcamera.Location, PointB=getcamera.Target, Unitize=False)  # -> Vector, Length
cir = Circle(Plane=move_4.Geometry, Radius=Slider(38, range=0..100))
Z_3 = UnitZ(Factor=1)
int_disttoadd = Integer(flatten(multiplication_2))
merge_6 = Merge(Data2=orient.Geometry)
pt_11 = Point(end_4.End)
unit = UnitVector(Vector=vec2pt_3.Vector)
panel_15 = Panel("""150
50""")
neg_2 = Negative(Value=Slider(41, range=0..1100))
panel_16 = Panel("""150
50""")
amp_3 = Amplitude(Vector=vec2pt_2.Vector, Amplitude=neg_2)
dash = DashPattern(Curve=ln_3, Pattern=panel_15)  # -> Dashes, Gaps
orient_2 = OrientDirection(Geometry=cir, PointA=move_4.Geometry, DirectionA=Z_3, PointB=move_4.Geometry, DirectionB=unit)  # -> Geometry, Transform
dash_2 = DashPattern(Curve=merge_6, Pattern=panel_16)  # -> Dashes, Gaps
cir_2 = Circle(Plane=pt_11, Radius=Slider(38, range=0..100))
move_5 = Move(Geometry=pt_11, Motion=amp_3)  # -> Geometry, Transform
merge_7 = Merge(Data1=dispatch_18.ListA, Data2=dispatch_19.ListA)
X = UnitX(Factor=Slider(125, range=0..1100))
number_slider_3 = Slider(2, range=0..10)
X_2 = UnitX(Factor=Slider(107, range=0..1100))
boundary = BoundarySurfaces(Edges=merge_7)  # -> flatten(Surfaces)
swatch = ColourSwatch(SwatchColor=RGB(0, 0, 0))
# AXON NOTATION
swatch_2 = ColourSwatch(SwatchColor=RGB(0, 0, 0))
move_6 = Move(Geometry=move_4.Geometry, Motion=X)  # -> Geometry, Transform
move_7 = Move(Geometry=move_5.Geometry, Motion=X_2)  # -> Geometry, Transform
circle_5 = CircleCNR(Center=pt_subway_stops_11, Normal=Vector(0, 0, 1), Radius=Slider(65, range=0..100))
ft_min_walking_3 = Panel("273")
# PLAN NOTATION
number_slider_4 = Slider(10, range=0..10)
area_6 = Area(Geometry=boundary)  # -> Area, Centroid
dist_6 = Distance(PointA=graft(area_6.Centroid), PointB=flatten(area_3.Centroid))

# ---- group: Walking dist. from each center plus travel time to reach center
addition_3 = Addition(A=int_disttoadd, B=dist_6)

# ----
sort_6 = SortList(Keys=addition_3)  # -> Keys, ValuesA
item_7 = ListItem(List=sort_6.Keys, Index=0, Wrap=True)  # -> flatten(Item)
num_score = Number(item_7)
lng_3 = ListLength(List=merge_7)
pt_center_6 = Point(pt_center)
boundary_2 = BoundarySurfaces(Edges=circle_5)
previewlw_3 = CustomPreviewLineweights(Geometry=dash.Dashes, Shader=swatch_2, Thickness=Slider(1, range=0..10), Absolute=False)
previewlw_4 = CustomPreviewLineweights(
    Geometry=orient_2.Geometry,
    Shader=ColourSwatch(SwatchColor=RGB(0, 0, 0)),
    Thickness=Slider(2, range=0..10),
    Absolute=False)
screentext = ScreenOrientedText(
    Text=panel_14,
    Font="Garamond Bold",
    Justification=4,
    Location=move_6.Geometry,
    SizeFactor=Slider(14, range=0..100),
    Depth=0,
    Absolute=False)
previewlw_5 = CustomPreviewLineweights(Geometry=dash_2.Dashes, Shader=swatch, Thickness=Slider(1, range=0..10), Absolute=False)
previewlw_6 = CustomPreviewLineweights(Geometry=cir_2, Shader=swatch, Thickness=number_slider_3, Absolute=False)
screentext_2 = ScreenOrientedText(
    Text=panel_14,
    Font="Garamond Bold",
    Justification=4,
    Location=move_7.Geometry,
    SizeFactor=Slider(14, range=0..100),
    Depth=0,
    Absolute=False)
buildings = Panel(lng_3)
dist_7 = Distance(PointA=area_6.Centroid, PointB=pt_center_6)
previewlw_7 = CustomPreviewLineweights(Geometry=circle_5, Shader=swatch, Thickness=number_slider_3, Absolute=False)
division_4 = Division(A=num_score, B=ft_min_walking_3)
preview = CustomPreview(Geometry=flatten(merge_7), Shader=ColourSwatch(SwatchColor=RGB(237, 79, 36)))
Z_4 = UnitZ(Factor=number_slider_4)
sort_7 = SortList(Keys=dist_7)  # -> Keys, ValuesA
round = Round(Number=division_4)  # -> Nearest, Floor, flatten(Ceiling)
move_8 = Move(Geometry=boundary_2, Motion=Z_4)  # -> Geometry, Transform
item_8 = ListItem(List=reverse(sort_7.Keys), Index=0, Wrap=True)
bnd = Bounds(Numbers=round.Ceiling)
max_distance = Panel(item_8)
panel_17 = Panel(bnd)
preview_2 = CustomPreview(Geometry=move_8.Geometry, Shader=ColourSwatch(SwatchColor=RGB(184, 54, 28)))
pipeline = GeometryPipeline(
    GroupByLayer=False,
    GroupByType=False,
    IncludeHidden=True,
    IncludeLocked=True,
    LayerFilter="SHORELINE",
    NameFilter="*",
    TypeFilter=4)
bnd_2 = Bounds(Numbers=round.Ceiling)
swatch_3 = ColourSwatch(SwatchColor=RGB(166, 166, 166))
dedomain = DeconstructDomain(Domain=bnd_2)  # -> Start, End
gradient = Gradient(
    LowerLimit=dedomain.Start,
    UpperLimit=dedomain.End,
    Parameter=round.Ceiling,
    stops=[0.103: RGB(191, 38, 0), 0.371: RGB(219, 104, 66), 0.698: RGB(255, 163, 140), 1: RGB(255, 230, 222)])
previewlw_8 = CustomPreviewLineweights(Geometry=pipeline, Shader=ColourSwatch(SwatchColor=RGB(61, 61, 61)), Thickness=Slider(1, range=0..10), Absolute=False)
geo = Geometry(boundary)
number_slider_5 = Slider(100, range=0..100)
number_slider_6 = Slider(10, range=0..10)
series_3 = Series(Start=0, Step=number_slider_5, Count=number_slider_6)
planesrf = PlaneSurface(Plane=PlaneXY(0, 0, 0), XSize=number_slider_5, YSize=number_slider_5)
createatts = CreateAttributes(LayerName="buildings_baked_queens", Color=gradient, enableFullPath=False)
preview_3 = CustomPreview(Geometry=geo, Shader=gradient)
X_3 = UnitX(Factor=series_3)
bnd_3 = Bounds(Numbers=series_3)
dedomain_2 = DeconstructDomain(Domain=bnd_3)  # -> Start, End
move_9 = Move(Geometry=planesrf, Motion=X_3)  # -> Geometry, Transform
gradient_2 = Gradient(
    LowerLimit=dedomain_2.Start,
    UpperLimit=dedomain_2.End,
    Parameter=series_3,
    stops=[0.103: RGB(191, 38, 0), 0.371: RGB(219, 104, 66), 0.698: RGB(255, 163, 140), 1: RGB(255, 230, 222)])
bake = BakeGeometry(Bake=Button(), Geometry=geo, Attributes=createatts, DeleteOldBakes=False, PreserveTrees=False)
debrep = DeconstructBrep(Brep=move_9.Geometry)  # -> Faces, Edges, Vertices
panel_18 = Panel(""" minute
 minutes
 minutes
 minutes
 minutes
 minutes
 minutes
 minutes
 minutes
 minutes""")
series_4 = Series(Start="1", Step=1, Count=number_slider_6)
brep = Brep(move_9.Geometry)
int_3 = Integer(series_4)
concat = Concatenate(FragmentA=int_3, FragmentB=panel_18)
vec = VectorXYZ(XComponent=Slider(0, range=0..10), YComponent=Slider(5.3, range=0..10), ZComponent=0)  # -> Vector, Length
item_9 = ListItem(List=debrep.Vertices, Index=Slider(3, range=0..10), Wrap=True)
preview_4 = CustomPreview(Geometry=brep, Shader=gradient_2)
preview_5 = CustomPreview(Geometry=debrep.Edges, Shader=ColourSwatch(SwatchColor=RGB(171, 48, 48)))
panel_19 = Panel(concat)
move_10 = Move(Geometry=item_9, Motion=vec.Vector)  # -> flatten(Geometry), Transform
screentext_3 = ScreenOrientedText(
    Text=concat,
    Font="Garamond",
    Justification=7,
    Location=move_10.Geometry,
    SizeFactor=Slider(36, range=0..100),
    Depth=0,
    Absolute=False)

# ==== cluster ClusterColors
swatch = ColourSwatch(SwatchColor=RGB(217, 4, 4))
swatch_2 = ColourSwatch(SwatchColor=RGB(4, 148, 28))
swatch_3 = ColourSwatch(SwatchColor=RGB(168, 52, 2))
swatch_4 = ColourSwatch(SwatchColor=RGB(21, 46, 189))
swatch_5 = ColourSwatch(SwatchColor=RGB(255, 128, 0))
swatch_6 = ColourSwatch(SwatchColor=RGB(255, 234, 48))
trains = Panel("""1
2
3
4
5
6
7
A
C
E
B
D
F
M
G
J
Z
N
Q
R
W
S
L""")
M = ClusterInput()
merge = Merge(
    Data1=swatch,
    Data2=swatch,
    Data3=swatch,
    Data4=swatch_2,
    Data5=swatch_2,
    Data6=swatch_2,
    Data7=ColourSwatch(SwatchColor=RGB(143, 0, 204)),
    Data8=swatch_4,
    Data9=swatch_4,
    Data10=swatch_4,
    Data11=swatch_5,
    Data12=swatch_5,
    Data13=swatch_5,
    Data14=swatch_5,
    Data15=ColourSwatch(SwatchColor=RGB(126, 189, 137)),
    Data16=swatch_3,
    Data17=swatch_3,
    Data18=swatch_6,
    Data19=swatch_6,
    Data20=swatch_6,
    Data21=swatch_6,
    Data22=ColourSwatch(SwatchColor=RGB(201, 201, 201)),
    Data23=ColourSwatch(SwatchColor=RGB(125, 125, 125)))
mindex = MemberIndex(Set=trains, Member=M)  # -> Index, Count
I = ClusterOutput(mindex.Index)
item = ListItem(List=merge, Index=mindex.Index, Wrap=True)
i = ClusterOutput(item)

# ==== cluster Format
int_adds_thousands_separator = ClusterInput()
int_adds_thousands_separator_2 = Integer(graft(int_adds_thousands_separator))
chars = Characters(Text=int_adds_thousands_separator_2)  # -> Result, Unicode
rev = ReverseList(List=chars.Result)
lng = ListLength(List=rev)
division = Division(A=lng, B="3")
round = Round(Number=division)  # -> Nearest, Floor, Ceiling
series = Series(Start=expr("x-1", "3"), Step="3", Count=round.Ceiling)
series_2 = Series(Start=0, Step="3", Count=round.Ceiling)
subtraction = Subtraction(A=lng, B="1")
min = Minimum(A=series, B=subtraction)
dom = ConstructDomain(DomainStart=series_2, DomainEnd=min)
subset = SubList(List=rev, Domain=dom, Wrap=True)  # -> List, Index
join = TextJoin(Text=subset.List)
concat = Concatenate(FragmentA=join, FragmentB=",")
path_mapper = PathMapper(concat, source="{A;B;C}", target="{A;B}")
join_2 = TextJoin(Text=flatten(concat))
chars_2 = Characters(Text=join_2)  # -> Result, Unicode
lng_2 = ListLength(List=chars_2.Result)
split = SplitList(List=chars_2.Result, Index=expr("x-1", lng_2))  # -> ListA, ListB
rev_2 = ReverseList(List=split.ListA)
join_3 = TextJoin(Text=rev_2)
data_with_commas = Data(flatten(join_3))
data_with_commas_2 = ClusterOutput(data_with_commas)
